# Grasshopper definition GH_python_remote_test.ghx (Grasshopper 1.0.7)
# Copyright: © 2017-2022 Pierre Cuvilliers, Caitlin Mueller, Massachusetts Institute of Technology

panel = Panel("""numpy
scipy
matplotlib
matplotlib.pyplot""")
# GH to python remote test.
# ⓒ Pierre Cuvilliers, 2017-2022
# Released under the MIT license
# github.com/pilcru/ghpythonremote
# Runs and connects to an external python engine, and
# assigns imported modules to scriptcontext.sticky variables.
# 
# Arguments:
#       code (str): Path to the GH_to_python.py code file.
#       location (str): Path to a python executable, or to a folder
#             containing `python.exe`, or the name of a conda-created
#             virtual environment prefixed by `conda://` (`conda://env_name`).
#             If empty, finds python from your windows %PATH%.
#       run (boolean): Creates the connection, and imports new
#             modules, when turned to True. Kills the connection,
#             and deletes the references to the imports, when turned
#             to False.
#       modules (str list): List of module names to import in the
#             remote python. They will be added to the
#             scriptcontext.sticky dictionary, allowing them to be
#             reused from other python components in the same
#             Grasshopper document. Submodules (for example
#             `numpy.linalg`) have to be added explicitly to this list
#             to be available later, and importing the parent package is
#             also required even if only the submodule is used.
#       log_level (str from ['NOTSET', 'DEBUG', 'INFO', 'WARNING', 'ERROR', 'CRITICAL']):
#             Logging level to use for the local IronPython and the
#             remote python instance.
#       working_dir (str): Working directory for the remote python
#             instance.
# 
# Returns:
#       out (str): Console output with DEBUG information.
#       linked_modules (str list): list of imported module names.
#       rpy (rpyc connection object): The object representing the
#             remote Python interpreter.
panel_2 = Panel("conda://rhinoremote")
pythonremote = GHPythonRemote(location=panel_2, run=Toggle(False), modules=panel)  # -> out, linked_modules, rpy, import_statements
panel_3 = Panel(pythonremote.out)
python = PythonScript()  # -> out, a
# ---------- python: Python ----------
import scriptcontext
np = scriptcontext.sticky['numpy']
mpl = scriptcontext.sticky['matplotlib']

plt = mpl.pyplot

# The following is fixed when the conda paths are added to
# the CPython subprocess:

# Qt doesn't find its bearings, for some reason
# so we switch to another backend.
# This might be fixed by copying the qt.conf file 
# at the root of the env to a system-wide location,
# if that even exists. Setting os environment variable
# QT_PLUGIN_PATH to the correct location might work too,
# but shouldn't be done system-wide because it will mess
# up other installs. Doing it for this application only
# is equally annoying because it has to be done before
# matplotlib is imported.
# # mpl.use('TKAgg')  # Maybe works for matplotlib >= 3.1.0
# plt.switch_backend('TKAgg')


b = np.random.random((5,5))
a = ">>> mat = np.random.random((5,5))\n>>> print(mat)\n"
a += str(b)
a += "\n\n>>> np.linalg.eig(mat)\n"
a += '\n'.join(np.linalg.eig(b)[0])

Y, X = np.mgrid[-3:3:100j, -3:3:100j]
U = -1 - X**2 + Y
V = 1 + X - Y**2
speed = np.sqrt(U*U + V*V)

fig1, (ax1, ax2) = plt.subplots(ncols=2)
ax1.streamplot(X, Y, U, V, density=[0.5, 1])

lw = 5*speed / speed.max()
ax2.streamplot(X, Y, U, V, density=0.6, color='k', linewidth=lw)

a += "\n\n>>> ...matplotlib code...\n>>> plt.show()"
plt.show()

import scriptcontext
import ghpythonremote
np = scriptcontext.sticky['numpy']
rpy = scriptcontext.sticky['rpy']
# Do some numpy stuff
a = np.arange(15).reshape(3, 5)
print(a)
print(np.linalg.eig(np.arange(9).reshape(3, 3)))

# Fast way of sending data for numpy array creation
remote_range = ghpythonremote.deliver(rpy, range(1000))
array = np.array(remote_range)
# This is much slower
#b = np.array(range(1000))

# Get the array back as a local IronPython list
list = ghpythonremote.obtain(array.tolist())

# Get an error
#np.arange(9).reshape(4,3)

x = ("he", 7, u"llo", 8, (), 900, None, True, Ellipsis, 18.2, 18.2j + 13,
     slice(1,2,3), frozenset([5,6,7]), NotImplemented)
from rpyc.core.brine import dump, load
y = dump(x)
z = load(str(y))
assert(x == z)

x = ("he", 7, u"llo", 8, (), 900, None, True, 18.2, 18.2j + 13,
     slice(1,2,3), frozenset([5,6,7]), range(10))
print(x)
rx = ghpythonremote.deliver(rpy, x)
print(rx)
lrx = ghpythonremote.obtain(rx)
print(lrx)

assert(x == lrx)

import scriptcontext
np = scriptcontext.sticky['numpy']
cv2 = scriptcontext.sticky['cv2']
cap = cv2.VideoCapture(0)

while(True):
    # Capture frame-by-frame
    ret, frame = cap.read()

    # Our operations on the frame come here
    gray = cv2.cvtColor(frame, cv2.COLOR_BGR2GRAY)

    # Display the resulting frame
    cv2.imshow('frame',gray)
    if cv2.waitKey(1) & 0xFF == ord('q'):
        break

# When everything done, release the capture
cap.release()
cv2.destroyAllWindows()
# ---------- end python ----------
panel_4 = Panel(python.a)

# ==== cluster GHPythonRemote: Connects the Grasshopper Python component to an external Python instance.
python = PythonScript()  # -> default_working_dir
# ---------- python: Python ----------
from os import path
from Grasshopper.Folders import UserObjectFolders

cluster_comp = ghenv.Component.OnPingDocument().Owner
parent_doc_path = cluster_comp.OnPingDocument().FilePath

if parent_doc_path is not None:
    # Get path to parent GH document
    default_working_dir = path.abspath(path.dirname(parent_doc_path))
else:
    # Fallback to path to user objects default dir
    uo_folder = path.abspath(UserObjectFolders[0])
    if path.isdir(path.join(uo_folder, "gh-python-remote")):
        uo_folder = path.abspath(path.join(uo_folder, "gh-python-remote"))
    default_working_dir = uo_folder
# ---------- end python ----------
# GH to python remote example.
# ⓒ Pierre Cuvilliers, 2017-2022
# Released under the MIT license
# github.com/pilcru/ghpythonremote
# Runs and connects to an external python engine, and
# assigns imported modules to scriptcontext.sticky variables.
# 
# Arguments:
#       code (str): Path to the GH_to_python_sticky.py code file.
#       location (str): Path to a python executable, or to a folder
#             containing `python.exe`, or the name of a conda-created
#             virtual environment prefixed by `conda://` (`conda://env_name`).
#             If empty, finds python from your windows %PATH%.
#       run (boolean): Creates the connection, and imports new
#             modules, when turned to True. Kills the connection,
#             and deletes the references to the imports, when turned
#             to False.
#       modules (str list): List of module names to import in the
#             remote python. They will be added to the
#             scriptcontext.sticky dictionary, allowing them to be
#             reused from other python components in the same
#             Grasshopper document. Submodules (for example
#             `numpy.linalg` have to be added explicitly to this list
#             to be available later.
#       log_level (str from ['NOTSET', 'DEBUG', 'INFO', 'WARNING', 'ERROR', 'CRITICAL']):
#             Logging level to use for the local IronPython and the
#             remote python instance.
#       working_dir (str): Working directory for the remote python
#             instance.
# 
# Returns:
#       out (str): Console output with DEBUG information.
#       linked_modules (str list): list of imported module names.
#       rpy (rpyc connection object): The object representing the
#             remote Python interpreter.
location = ClusterInput()  # location (str): Path to a python executable, or to a folder containing `python.exe`, or the name of a conda-created virtual environment prefixed by `conda://` (`conda://env_name`). If empty, finds python from your windows %PATH%.
run = ClusterInput()  # run (boolean): Creates the connection, and imports new modules, when turned to True. Kills the connection,and deletes the references to the imports, when turned to False.
modules = ClusterInput()  # modules (str list): List of module names to import in the remote python. They will be added to the scriptcontext.sticky dictionary, allowing them to be reused from other python components in the same Grasshopper document. Submodules (for example `numpy.linalg` have to be added explicitly to this list to be available later.
list = ValueList({"CRITICAL", "ERROR", "WARNING", "INFO", "DEBUG", "NOTSET"}, selected="DEBUG")
panel = Panel(python)
ghpythonremote = GHPythonRemote(location=location, run=run, modules=modules, log_level=list, working_dir=panel)  # -> out, linked_modules, rpy; inputs run: Boolean, modules: list
# ---------- ghpythonremote: Python ----------
import inspect
import logging
from os import path
import sys
from time import sleep

import scriptcontext

import ghpythonremote
from ghpythonremote.connectors import GrasshopperToPythonRemote
from Grasshopper.Kernel.GH_RuntimeMessageLevel import Error, Warning

local_log_level = getattr(logging, log_level, logging.WARNING)
logger = logging.getLogger("ghpythonremote")
logger.setLevel(local_log_level)
ch = logging.StreamHandler()
ch.setLevel(local_log_level)
formatter = logging.Formatter("%(levelname)s: %(name)s:\n%(message)s")
ch.setFormatter(formatter)
logger.handlers = []
logger.addHandler(ch)
logger = logging.getLogger("ghpythonremote.GH_to_python")

ROOT = path.abspath(path.dirname(inspect.getfile(ghpythonremote)))
rpyc_server_py = path.join(ROOT, "pythonservice.py")

cluster_comp = ghenv.Component.OnPingDocument().Owner

# Set connection to CLOSED if this is the first run
# and initialize set of linked modules
try:
    remote_python_status
except NameError:
    remote_python_status = "CLOSED"
    lkd_modules = set()

# Wait for connection to connect or terminate
timer = 0
while remote_python_status == "CONNECTING" or remote_python_status == "CLOSING":
    sleep(1)
    timer += 1
    if timer == 10:
        try:
            gh2py_manager.__exit__(*sys.exc_info())
        except Exception:
            pass
        remote_python_status = "CLOSED"
        lkd_modules = set()
        message = (
            "Connection left in an inconsistent state and not returning. Reset "
            "everything."
        )
        if cluster_comp is not None:
            cluster_comp.AddRuntimeMessage(Warning, message)
        raise RuntimeError(message)

if run:
    if not remote_python_status == "OPEN":
        remote_python_status = "CONNECTING"
        gh2py_manager = GrasshopperToPythonRemote(
            rpyc_server_py,
            location=location,
            timeout=10,
            port=None,
            log_level=log_level,
            working_dir=working_dir,
        )
        gh2py = gh2py_manager.__enter__()
        remote_python_status = "OPEN"

    # Stuff that we can reach
    rpymod = gh2py.py_remote_modules  # A getter function for a named python module
    rpy = gh2py.connection  # Represents the remote instance root object
    scriptcontext.sticky["rpy"] = rpy
    # Add modules
    for mod in modules:
        try:
            scriptcontext.sticky[mod] = rpymod(mod)
            lkd_modules.add(mod)
        except ImportError:
            gh2py_manager.__exit__(*sys.exc_info())
            if cluster_comp is not None:
                cluster_comp.AddRuntimeMessage(
                    Error,
                    'Could not import module "{}" in remote Python.'.format(mod)
                )
            raise
        except EOFError:
            if cluster_comp is not None:
                cluster_comp.AddRuntimeMessage(
                    Error,
                    'Remote Python has been closed unexpectedly'
                )
            raise

elif not remote_python_status == "CLOSED":
    remote_python_status = "CLOSING"
    # Remove linked modules
    for mod in lkd_modules:
        del scriptcontext.sticky[mod]
    del scriptcontext.sticky["rpy"]
    gh2py_manager.__exit__(*sys.exc_info())
    lkd_modules = set()
    remote_python_status = "CLOSED"

# Change variable name because ghpython resets outputs to None before each run
linked_modules = lkd_modules

logger.info("GH to python connection is {}".format(remote_python_status))
# ---------- end ghpythonremote ----------
out = ClusterOutput(ghpythonremote.out)  # Console output.
linked_modules = ClusterOutput(ghpythonremote.linked_modules)  # Names of modules that were successfully added to the scriptcontext.sticky dictionary.
rpy = ClusterOutput(ghpythonremote.rpy)  # The object representing the remote python instance
python_2 = PythonScript(module_names=ghpythonremote.linked_modules)  # -> import_statements; inputs module_names: list
# ---------- python_2: Python ----------
import_statements = ["import scriptcontext as sc"]
for module_name in module_names:
    import_statements.append("{0} = sc.sticky['{0}']".format(module_name))

if len(module_names) == 0:
    import_statements = []
# ---------- end python_2 ----------
import_statements = ClusterOutput(python_2)  # Useful import statements to use the imported modules in your scripts.
